# Dynamo graph Cria_Pontos_Familia.dyn (Dynamo 2.0.4.12684)

start = IntegerSlider(71, range=0..100 step 1)  # graph input
step = IntegerSlider(67, range=0..100 step 1)  # graph input
stop = IntegerSlider(232, range=0..500 step 1)  # graph input
tipo_de_família = FamilyTypes(index=90)  # graph input
nível_do_projeto = Levels(index=4)  # graph input
python_script = Python(IN[0]=start, IN[1]=step, IN[2]=stop, IN[3]=tipo_de_família, IN[4]=nível_do_projeto)
# ---------- python_script.python (28 lines) ----------
# Enable Python support and load DesignScript library
import clr
clr.AddReference('ProtoGeometry')
import clr
clr.AddReference('RevitNodes')
import Revit
clr.ImportExtensions(Revit.Elements)
from Autodesk.DesignScript.Geometry import *

# The inputs to this node will be stored as a list in the IN variables.
start = IN[0]
step = IN[1]
stop = IN[2]
family = IN[3]
level = IN[4]

list = []

# Place your code below this line

for x in range(start, stop, step):
	for y in range( start, stop, step):
		list.append(Revit.Elements.FamilyInstance.ByPointAndLevel(family,Point.ByCoordinates(x,y),level))
		


# Assign your output to the OUT variable.
OUT = list
# ----------------------------------------
